# Grasshopper definition demo.gh (Grasshopper 1.0.7)
# plug-ins: gonect

# ----
# Color Palette (255 Colors)
number_slider = Slider(255, range=0..1000)
number_slider_2 = Slider(1, range=0..1)
range = Range(Domain="0.0 To 2.1", Steps=number_slider)
hsv = ColourHSV(Alpha=1, Hue=range, Saturation=number_slider_2, Value=number_slider_2)
rev = ReverseList(List=hsv)

# ----
# Crop Box on a 640x480 basis
number_slider_3 = Slider(60, range=0..100)
pt = ConstructPoint(XCoordinate=number_slider_3, YCoordinate=number_slider_3, ZCoordinate=0)
pt_2 = ConstructPoint(XCoordinate=Slider(550, range=0..1000), YCoordinate=Slider(400, range=0..1000), ZCoordinate=0)
rec_2pt = Rectangle2Pt(Plane=PlaneXY(0, 0, 0), PointA=pt, PointB=pt_2, Radius=0)  # -> Rectangle, Length

# ----
# Gonect Settings
panel = Panel("http://10.0.2.2:4777")

number_slider_4 = Slider(350, range=0..1000)
getmesh = GetGonectMesh(Url=panel, Freq=Slider(0, range=0..100), ColorPalette=rev, CroppingFrame=rec_2pt.Rectangle)
mblur = BlurMesh(Mesh=getmesh, Iterations=1)

# ----
# Height Contour Lines
number_slider_5 = Slider(20, range=0..100)
dup = DuplicateData(Data=Slider(10, range=0..10), Number=number_slider_5, Order=True)
contour = ContourEx(Shape=mblur, Plane=PlaneXY(0, 0, 0), Distances=dup)  # disabled
